# Grasshopper definition vision.gh (Grasshopper 1.0.8)
# plug-ins: Weaverbird

viewpoint = Point(Point(268.5633525, -1612.146342, 697.9478672))
windowmesh = Mesh(<mesh referenced from the Rhino model>)
# please set direction first
obstaclesmesh = Mesh([<mesh referenced from the Rhino model> x8])
unit_x = UnitX(Factor=1)
ray_density = Slider(60, range=0..1000)
aspect_ratio = Slider(5, range=0..10)
smoothness = Slider(10, range=0..10)
shape_factor = Slider(300, range=0..10000)
field_of_view = Slider(15, range=0..20, expression="x*1000")
deconstruct_vector = DeconstructVector(Vector=viewpoint)  # -> XComponent, YComponent, ZComponent
subtraction = Subtraction(A=deconstruct_vector.XComponent, B=field_of_view)
deconstruct_mesh = DeconstructMesh(Mesh=windowmesh)  # -> Vertices, Faces, Colours, Normals
vector_xyz = VectorXYZ(XComponent=subtraction, YComponent=deconstruct_vector.YComponent, ZComponent=deconstruct_vector.ZComponent)  # -> Vector, Length
unit_z = UnitZ(Factor=expr("-963", 1))
vector_xyz_2 = VectorXYZ(XComponent=deconstruct_vector.XComponent, YComponent=deconstruct_vector.YComponent, ZComponent=expr("-25000", 0))  # -> Vector, Length
vector_2pt = Vector2Pt(PointA=viewpoint, PointB=flatten(deconstruct_mesh.Vertices), Unitize=False)  # -> simplify(Vector), Length
plane_normal = PlaneNormal(Origin=vector_xyz.Vector, ZAxis=unit_x)
xy_plane = XYPlane(Origin=unit_z)
line_sdl = LineSDL(Start=viewpoint, Direction=vector_2pt.Vector, Length=expr("X+500", field_of_view))
unit_z_2 = UnitZ(Factor=expr("50000", 1))
line_plane = LinePlane(Line=line_sdl, Plane=plane_normal)  # -> Point, ParamL, ParamP
delaunay_mesh = DelaunayMesh(Points=line_plane.Point, Plane=plane_normal)
deconstruct_mesh_2 = DeconstructMesh(Mesh=delaunay_mesh)  # -> Vertices, Faces, Colours, Normals
hull = ConvexHull(Points=deconstruct_mesh_2.Vertices, Plane=plane_normal)  # -> Hull, HullZ, Indices
vb_script = VBScript(P=deconstruct_mesh_2.Vertices, H=hull.Hull, F=Slider(0.105, range=0..1))  # -> out, C; inputs P: list of Point3d, H: Polyline
# ---------- vb_script: VB usings ----------
Imports System.IO
Imports System.Linq
Imports System.Data
Imports System.Drawing
Imports System.Reflection
Imports System.Windows.Forms
Imports System.Xml
Imports System.Xml.Linq
Imports System.Runtime.InteropServices

Imports Rhino.DocObjects
Imports Rhino.Collections
Imports GH_IO
Imports GH_IO.Serialization
# ---------- vb_script: VB ----------
    F = Math.Max(F, 0.01)

    Dim map As New List(Of Boolean)
    For i As Int32 = 0 To P.Count - 1
      Dim Pp As Point3d = H.ClosestPoint(P(i))
      If (Pp.DistanceTo(P(i)) < 1e-6) Then
        map.Add(True)
      Else
        map.Add(False)
      End If
    Next

    Dim edges As New List(Of Line)
    For i As Int32 = 0 To H.Count - 2
      Dim edge As New Line(H(i), H(i + 1))
      SubDivide(edge, edges, P, map, F, 0)
    Next
    C = edges
# ---------- vb_script: VB additional code ----------
  Private Function NearestPoint(edge As Line, P As List(Of Point3d), M As List(Of Boolean), ByRef distance As Double) As Int32
    distance = Double.maxvalue
    Dim minI As Int32 = -1
    For i As Int32 = 0 To P.Count - 1
      If (M(i)) Then Continue For

      Dim localD As Double = edge.DistanceTo(P(i), True)
      If (localD < 1e-12) Then Continue For
      If (localD < distance) Then
        distance = localD
        minI = i
      End If
    Next
    Return minI
  End Function

  Private Sub SubDivide(ByVal edge As Line, edges As List(Of Line), P As List(Of Point3d), M As List(Of Boolean), F As Double, N As Int32)
    If (edges.Count >= P.Count) Then Return
    If (N > P.Count) Then Return

    Dim length As Double = edge.Length
    If (length < 1e-2) Then
      edges.Add(edge)
      Return
    End If

    Dim minD As Double
    Dim minI As Int32 = NearestPoint(edge, P, M, minD)
    If (minI < 0) Then
      edges.Add(edge)
      Return
    End If

    If (length * F < minD) Then
      edges.Add(edge)
      Return
    End If

    Dim e1 As New Line(edge.From, P(minI))
    Dim e2 As New Line(P(minI), edge.To)
    M(minI) = True

    Subdivide(e1, edges, P, M, F, N + 1)
    Subdivide(e2, edges, P, M, F, N + 1)
  End Sub
# ---------- end vb_script ----------
boundary_surfaces = BoundarySurfaces(Edges=vb_script.C)
multiplication = Multiplication(A=ray_density, B=aspect_ratio)
divide_surface = DivideSurface(Surface=boundary_surfaces, UCount=multiplication, VCount=ray_density)  # -> Points, Normals, Parameters
vector_2pt_2 = Vector2Pt(PointA=viewpoint, PointB=flatten(divide_surface.Points), Unitize=False)  # -> simplify(graft(Vector)), Length
clean_tree = CleanTree(RemoveNulls=True, RemoveInvalid=True, RemoveEmpty=True, Tree=vector_2pt_2.Vector)
line_sdl_2 = LineSDL(Start=viewpoint, Direction=clean_tree, Length=expr("X+500", field_of_view))
mesh_ray = MeshRay(Mesh=obstaclesmesh, Point=viewpoint, Direction=line_sdl_2)  # -> Point, Hit
mass_addition = MassAddition(Input=mesh_ray.Hit)  # -> Result, PartialResults
cull_pattern = CullPattern(List=line_sdl_2, CullPattern=invert(mass_addition.Result))
panel = Panel(mass_addition.Result)
panel_2 = Panel(mesh_ray.Hit)
line_plane_2 = LinePlane(Line=cull_pattern, Plane=plane_normal)  # -> flatten(Point), ParamL, ParamP
delaunay_edges = DelaunayEdges(Points=line_plane_2.Point, Plane=plane_normal)  # -> Connectivity, Edges
length = Length(Curve=delaunay_edges.Edges)
smaller_than = SmallerThan(FirstNumber=length, SecondNumber=shape_factor)  # -> SmallerThan, OrEqualTo
dispatch = Dispatch(List=delaunay_edges.Edges, DispatchPattern=smaller_than.SmallerThan)  # -> ListA, ListB
weaverbird_s_mesh_from_lines_weave_back = WeaverbirdsMeshFromLinesWeaveBack(Lines=dispatch.ListA, MaximumValence=4)
mesh_edges = MeshEdges(Mesh=weaverbird_s_mesh_from_lines_weave_back)  # -> NakedEdges, InteriorEdges, NonManifoldEdges
subtraction_2 = Subtraction(A=field_of_view, B=1000)
join_curves = JoinCurves(Curves=mesh_edges.NakedEdges, Preserve=False)
control_points = ControlPoints(Curve=join_curves)  # -> Points, Weights, Knots
circle_cnr = CircleCNR(Center=vector_xyz_2.Vector, Normal=unit_z, Radius=expr("x-100", subtraction_2))
circle_cnr_2 = CircleCNR(Center=vector_xyz_2.Vector, Normal=unit_z, Radius=subtraction_2)
nurbs_curve = NurbsCurve(Vertices=control_points.Points, Degree=smoothness, Periodic=False)  # -> Curve, Length, Domain
extrude = Extrude(Base=circle_cnr_2, Direction=unit_z_2)
extrude_point = ExtrudePoint(Base=nurbs_curve.Curve, Point=viewpoint)
unit_z_3 = UnitZ(Factor=24037)
split_brep = SplitBrep(Brep=extrude_point, Cutter=extrude)
move = Move(Geometry=circle_cnr, Motion=unit_z_3)  # -> Geometry, Transform
dispatch_2 = Dispatch(List=split_brep, DispatchPattern=[True, False])  # -> ListA, ListB
boundary_surfaces_2 = BoundarySurfaces(Edges=move.Geometry)
brep_plane = BrepPlane(Brep=dispatch_2.ListB, Plane=xy_plane)  # -> Curves, Points
surface_split = SurfaceSplit(Surface=boundary_surfaces_2, Curves=flatten(brep_plane.Curves))  # -> flatten(Fragments)
area = Area(Geometry=surface_split)  # -> Area, Centroid
sort_list = SortList(Keys=area.Area, ValuesA=surface_split)  # -> Keys, ValuesA
reverse_list = ReverseList(List=sort_list.ValuesA)
colour_rgb = ColourRGB(Alpha=255, Red=Slider(225, range=0..255), Green=Slider(159, range=0..255), Blue=Slider(172, range=0..255))
colour_rgb_2 = ColourRGB(
    Alpha=Slider(80, range=0..255),
    Red=Slider(190, range=0..255),
    Green=Slider(73, range=0..255),
    Blue=Slider(60, range=0..255))
cull_index = CullIndex(List=reverse_list, Indices=Slider(0, range=0..100), Wrap=True)
brep = Brep(dispatch_2.ListB)
custom_preview = CustomPreview(Geometry=cull_index, Material=colour_rgb)
custom_preview_2 = CustomPreview(Geometry=brep, Material=colour_rgb_2)
